# Grasshopper definition 4_1构建展平.gh (Grasshopper 1.0.7)

geo = Geometry(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)
srf = Surface(geo)
area = Area(Geometry=srf)  # -> Area, Centroid
evalsrf = EvaluateSurface(Surface=srf, Point=area.Centroid)  # -> Point, Normal, UDirection, VDirection, Frame
vec = Vector(evalsrf.Frame)
orient = OrientDirection(Geometry=srf, PointA=area.Centroid, DirectionA=vec, PointB=Point(0, 0, 0), DirectionB=Vector(0, 0, 1))  # -> Geometry, Transform
panel = Panel(vec)
